# Grasshopper definition CLOTH_18.gh (Grasshopper 1.0.7)
# plug-ins: Pufferfish, Kangaroo2 Components, Weaverbird

necklace_2 = Surface(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)
mesh = Mesh(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)

mesh_2 = Mesh(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)
srf = Surface(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)
pt = Point(Point(14.82509497, 6.682794328, 189.6379866))
pt_2 = Point(Point(6.277729671, 1.062120509, 182.5037269))
pt_3 = Point(Point(0.5764959071, 6.682794328, 188.7401011))
pt_4 = Point(Point(-4.055337104, -21.0167156, 169.4095813))
pt_5 = Point(Point(13.86872863, -21.0167156, 169.4095813))
pt_6 = Point(Point(8.309328648, -27.65999097, 122.3786936))
number_slider = Slider(18, range=0..100)
body = GetBoolean(Toggle(False), AtLeast=1, AtMost=1, FalseValue="False", TrueValue="True")
merge = Merge(Data1=pt, Data2=pt_2, Data3=pt_3)
merge_2 = Merge(Data1=pt_4, Data2=pt_5, Data3=pt_6)
pt_7 = Point(merge)
facen = FaceNormals(Mesh=mesh_2)  # -> Centers, Normals
pt_8 = Point(merge_2)
points = GetNumber(Slider(340, range=250..450), AtLeast=1, AtMost=1, Maximum=1.797693135e+308, Minimum=-1.797693135e+308)
filter = StreamFilter(Gate=body, Stream0=mesh)
sdivide = DivideSurface(Surface=necklace_2, UCount=number_slider, VCount=number_slider)  # -> Points, Normals, Parameters
popgeo = PopulateGeometry(Geometry=srf, Count=points, Seed=1)
pull = PullPoint(Point=facen.Centers, Geometry=merge_2, ClosestOnly=True)  # -> ClosestPoint, Distance
mcol = MeshColours(Mesh=filter, Colours=ColourSwatch(SwatchColor=RGB(240, 220, 149)))
min_scale = GetNumber(Slider(10, range=6..10), AtLeast=1, AtMost=1, Maximum=1.797693135e+308, Minimum=-1.797693135e+308)
max_scale = GetNumber(Slider(60, range=45..60), AtLeast=1, AtMost=1, Maximum=1.797693135e+308, Minimum=-1.797693135e+308)

# ---- group: RH_OUT:BODYYYYY
mesh_3 = Mesh(mcol)

# ----
bnd = Bounds(Numbers=pull.Distance)
pinch_radius = GetNumber(Slider(5, range=0..5), AtLeast=1, AtMost=2147483647, Maximum=1.797693135e+308, Minimum=-1.797693135e+308)
falloff = GetNumber(Slider(0.6, range=0.6..1), AtLeast=1, AtMost=2147483647, Maximum=1.797693135e+308, Minimum=-1.797693135e+308)
dom = ConstructDomain(DomainStart=min_scale, DomainEnd=max_scale)
group = GetNumber(Slider(4, range=4..6), AtLeast=1, AtMost=1, Maximum=1.797693135e+308, Minimum=-1.797693135e+308)
remap = RemapNumbers(Value=pull.Distance, Source=bnd, Target=dom)  # -> Mapped, Clipped
prox = Proximity3D(Points=popgeo, Group=group)  # -> Links, Topology
wbframe = WeaverbirdsPictureFrame(MeshPolylines=mesh_2, Distance=remap.Mapped, InsetType=0)
number_slider_2 = Slider(1.11, range=1.1..2)
p_n_s = PinchNSpreadPoints(
    Points=sdivide.Points,
    Locations=merge,
    Radii=expr("-x", pinch_radius),
    Strengths=Slider(1, range=0..10),
    Falloffs=falloff,
    Exponents=1,
    Weights1=1,
    Weights2=0)
nurbs = NurbsCurve(Vertices=p_n_s, Degree=3, Periodic=False)  # -> Curve, Length, Domain
mp = MultiPipe(
    Curves=prox.Links,
    NodeSize=Slider(0.12, range=0..1),
    EndOffset=Slider(0, range=0..100),
    StrutSize=1,
    Segment=0,
    KinkAngle=Slider(1, range=0..1),
    CubeFit=0,
    Caps=0)
wbthicken = WeaverbirdsMeshThicken(MeshCurves=wbframe, Distance=Slider(0.5, range=0..1), OffsetType=0)
meshsubd = MeshFromSubD(SubD=mp, Density=2)
mp_2 = MultiPipe(
    Curves=nurbs.Curve,
    NodeSize=Slider(0.06, range=0..0.1),
    EndOffset=1,
    StrutSize=1,
    Segment=0,
    KinkAngle=0.6,
    CubeFit=0,
    Caps=0)
wbcatmullclark = WeaverbirdsCatmullClarkSubdivision(MeshCurves=wbthicken, Level=Slider(2, range=0..10), SmoothNakedEdges=1)
mcol_2 = MeshColours(Mesh=meshsubd, Colours=ColourSwatch(SwatchColor=RGB(0, 0, 0)))
meshsubd_2 = MeshFromSubD(SubD=mp_2, Density=2)
mesh_4 = Mesh(mcol_2)
bracelet = GetBoolean(Toggle(False), AtLeast=1, AtMost=1, FalseValue="False", TrueValue="True")
mcol_3 = MeshColours(Mesh=wbcatmullclark, Colours=ColourSwatch(SwatchColor=RGB(255, 0, 0)))
mcol_4 = MeshColours(Mesh=meshsubd_2, Colours=ColourSwatch(SwatchColor=RGB(0, 0, 0)))
necklaceee = GetBoolean(Toggle(False), AtLeast=1, AtMost=1, FalseValue="False", TrueValue="True")
filter_2 = StreamFilter(Gate=bracelet, Stream0=mesh_4)
mesh_5 = Mesh(mcol_3)
mesh_6 = Mesh(filter_2)
flatten = FlattenTree(Tree=mesh_6, Path="{0}")
clsmsh = CloseMesh(Mesh=flatten, Quadrangulate=True)  # -> Closed, Amount, Openings, R
mesh_7 = Mesh(mcol_4)
dressss = GetBoolean(Toggle(False), AtLeast=1, AtMost=1, FalseValue="False", TrueValue="True")
filter_3 = StreamFilter(Gate=necklaceee, Stream0=mesh_7)
mesh_8 = Mesh(filter_3)
flatten_2 = FlattenTree(Tree=mesh_8, Path="{0}")

# ---- group: RH_OUT:BRACEEEEEEELET
mesh_9 = Mesh(filter_2)

# ----
volume = Volume(Geometry=flatten_2)  # -> Volume, Centroid
filter_4 = StreamFilter(Gate=dressss, Stream0=mesh_5)
mesh_10 = Mesh(filter_4)
flatten_3 = FlattenTree(Tree=mesh_10, Path="{0}")
volume_2 = Volume(Geometry=flatten_3)  # -> Volume, Centroid
volume_3 = Volume(Geometry=clsmsh.Closed)  # -> Volume, Centroid

# ---- group: RH_OUT:NECKLAACE
mesh_11 = Mesh(filter_3)

# ----
ma = MassAddition(Input=volume.Volume)  # -> Result, PartialResults

# ---- group: RH_OUT:DREESSSS
mesh_12 = Mesh(filter_4)

# ----
ma_2 = MassAddition(Input=volume_3.Volume)  # -> Result, PartialResults

# ---- group: kg
multiplication = Multiplication(A=volume_2.Volume, B=Slider(0.5, range=0..1))

multiplication_2 = Multiplication(A=ma.Result, B=Slider(0.5, range=0..1))

multiplication_3 = Multiplication(A=ma_2.Result, B=Slider(0.5, range=0..1))

# ---- group: price of silver
multiplication_4 = Multiplication(A=multiplication_2, B=Slider(51, range=0..1000))

# ---- group: price of fabric
multiplication_5 = Multiplication(A=multiplication, B=Slider(2, range=0..10))

# ---- group: price of silver
multiplication_6 = Multiplication(A=multiplication_3, B=Slider(51, range=0..100))

# ----
data = Data(multiplication_5)
data_2 = Data(multiplication_4)
data_3 = Data(multiplication_6)
panel = Panel(data)
panel_2 = Panel(data_2)
panel_3 = Panel(data_3)
addition = Addition(A=data_2, B=data, C=data_3)
roundd = RoundToDecimalPlace(NumberX=addition, DecimalPlace=Slider(2, range=0..10), RoundType=0)  # -> Rounded, Difference
merge_3 = Merge(Data1=flatten_2, Data2=flatten_3, Data3=clsmsh.Closed)
concat = Concatenate(FragmentA=roundd.Rounded, FragmentB="$")
data_4 = Data(concat)
c_script = CSharpScript(mesh=merge_3, PRICE=data_4)  # -> out, A; inputs mesh: Mesh
# ---------- c_script: C# ----------
    mesh.SetUserString("PRICE", PRICE.ToString());


    A = mesh;
# ---------- end c_script ----------
context_bake = ContextBake(Geometry=c_script.A)
panel_4 = Panel(data_4)
